# Grasshopper definition lorentz.gh (Grasshopper 0.9.76)

s = Slider(10, range=0..30)
b = Slider(2.667, range=0..5)
c_script = CSharpScript(s=s, r=Slider(28, range=0..50), b=b, dt=Slider(0.01, range=0..0.1), numSteps=Slider(4737, range=1..5000))  # -> out, lesPoints; inputs s: Double, r: Double, b: Double, dt: Double, numSteps: Int32
# ---------- c_script: C# ----------
    List< Rhino.Geometry.Point3d> laListe = new List< Rhino.Geometry.Point3d>();
    Rhino.Geometry.Point3d A = new Rhino.Geometry.Point3d(0, 1, 1.05);
    laListe.Add(A);
    for(int i = 0;i < numSteps;i++){
      double x1 = (s * (A.Y - A.X)) * dt;
      double y1 = (r * A.X - A.Y - A.X * A.Z) * dt;
      double z1 = (A.X * A.Y - b * A.Z) * dt;
      Rhino.Geometry.Point3d resu = A + new Rhino.Geometry.Point3d(x1, y1, z1);
      laListe.Add(resu);
      A = resu;
    }

    lesPoints = laListe;
# ---------- end c_script ----------
intcrv = Interpolate(Vertices=c_script.lesPoints, Degree=3, Periodic=False, KnotStyle=1)  # -> Curve, Length, Domain
pipe = Pipe(Curve=intcrv.Curve, Radius=Slider(0.006, range=0..1), Caps=0)
